# Grasshopper definition metro.gh (Grasshopper 1.0.7)
# plug-ins: LunchBox, Urbano

file_path = FilePath("C:\Users\dawar\projects\munich_new_metro_pbd\data\munich.csv")
read_file = ReadFile(File=file_path, PerLineParse=True)
read_metro_connections_csv = ReadFile(File="C:\Users\dawar\projects\munich_new_metro_pbd\data\metro_connections.csv", PerLineParse=True)
read_file_2 = ReadFile(File="C:\Users\dawar\projects\munich_new_metro_pbd\data\metro_stations.csv", PerLineParse=True)
read_csv = ReadCSV(CSVString=read_file, Delimiter=";")  # -> Headers, Values
panel = Panel(read_csv.Values)
read_csv_2 = ReadCSV(CSVString=read_file_2, Delimiter=";")  # -> Headers, Values
panel_2 = Panel(read_csv.Headers)

# ---- group: Generators
read_file_3 = ReadFile(File="C:\Users\dawar\projects\munich_new_metro_pbd\data\generators.csv", PerLineParse=True)
read_csv_3 = ReadCSV(CSVString=read_file_3, Delimiter=",")  # -> Headers, Values
panel_3 = Panel(read_csv_3.Headers)
explode_tree = ExplodeTree(Data=read_csv_3.Values)  # -> Branch0, Branch1, Branch2, Branch3, Branch4
construct_point = ConstructPoint(XCoordinate=explode_tree.Branch2, YCoordinate=explode_tree.Branch1, ZCoordinate=expr("0", 10))
project_geographic_point = ProjectGeographicPoint(Point=construct_point, Projection="WSG84 -> UTM", UTMZone="32")  # -> Out, UTMZone
panel_4 = Panel(construct_point)
generators = Point(project_geographic_point.Out)
unit_z = UnitZ(Factor=1000)
move = Move(Geometry=generators, Motion=unit_z)  # -> Geometry, Transform

# ----
panel_5 = Panel(read_csv_2.Headers)
explode_tree_2 = ExplodeTree(Data=read_csv_2.Values)  # -> Branch0, Branch1, Branch2
explode_tree_3 = ExplodeTree(Data=read_csv.Values)  # -> Branch0, Branch1, Branch2, Branch3, Branch4, Branch5
read_csv_4 = ReadCSV(CSVString=read_metro_connections_csv, Delimiter=";")  # -> Headers, Values
panel_6 = Panel(explode_tree_3.Branch0)
construct_point_2 = ConstructPoint(XCoordinate=explode_tree_2.Branch2, YCoordinate=explode_tree_2.Branch1, ZCoordinate=expr("0", 10))
panel_7 = Panel(explode_tree_3.Branch2)
population = Number(explode_tree_3.Branch5)
explode_tree_4 = ExplodeTree(Data=read_csv_4.Values)  # -> Branch0, Branch1
panel_8 = Panel(explode_tree_3.Branch1)
panel_9 = Panel(read_metro_connections_csv)
bounds = Bounds(Numbers=population)
panel_10 = Panel(population)
project_geographic_point_2 = ProjectGeographicPoint(Point=construct_point_2, Projection="WSG84 -> UTM", UTMZone="32")  # -> Out, UTMZone
panel_11 = Panel(construct_point_2)
construct_domain = ConstructDomain(DomainStart=Slider(100, range=1..3000), DomainEnd=Slider(1000, range=1..3000))
parse_polygon = CSharpScript(x=explode_tree_3.Branch2)  # -> out, A; inputs x: String
# ---------- parse_polygon: C# ----------
    var outList = new List<Point3d>();
    var cleanString = x.Substring(10, x.Length - 2 - 10);
    var textCoords = cleanString.Split(',');
    foreach (string textCoord in textCoords){
      var coords = textCoord.Trim().Split(' ');
      //Print(textCoord);
      //Print(coords.Length.ToString());
      //Print("-------");
      outList.Add(new Point3d(double.Parse(coords[0]), double.Parse(coords[1]), 0));
    }
    A = outList;
# ---------- end parse_polygon ----------
panel_12 = Panel(parse_polygon.out)
unit_z_2 = UnitZ(Factor=1000)
existing_metro_stations = Point(project_geographic_point_2.Out)
list_item = ListItem(List=existing_metro_stations, Index=explode_tree_4.Branch1, Wrap=True)
list_item_2 = ListItem(List=existing_metro_stations, Index=explode_tree_4.Branch0, Wrap=True)
line = Line(StartPoint=list_item_2, EndPoint=list_item)
remap_numbers = RemapNumbers(Value=population, Source=bounds, Target=construct_domain)  # -> Mapped, Clipped
project_geographic_point_3 = ProjectGeographicPoint(Point=parse_polygon.A, Projection="WSG84 -> UTM")  # -> Out, UTMZone
panel_13 = Panel(parse_polygon.A)
unit_z_3 = UnitZ(Factor=1000)
panel_14 = Panel(line)
move_2 = Move(Geometry=line, Motion=unit_z_2)  # -> Geometry, Transform
unit_z_4 = UnitZ(Factor=remap_numbers.Mapped)
colour = Colour(RGB(0, 87, 85))
panel_15 = Panel(project_geographic_point_3.Out)
polyline = PolyLine(Vertices=project_geographic_point_3.Out, Closed=True)
boundary_surfaces = BoundarySurfaces(Edges=polyline)
colour_2 = Colour(RGB(0, 161, 158))
custom_preview = CustomPreview(GeneratorsGeometry=move.Geometry, Material=colour_2)

# ---- group: Metro System
custom_preview_2 = CustomPreview(Geometry=move_2.Geometry, Material=colour)
move_3 = Move(Geometry=existing_metro_stations, Motion=unit_z_3)  # -> Geometry, Transform

# ----
map2d = Surface(flatten(boundary_surfaces))
extrude = Extrude(Base=map2d, Direction=unit_z_4)

# ---- group: Density
area = Area(Geometry=map2d)  # -> Area, Centroid
panel_16 = Panel(area.Area)  # disabled
division = Division(A=population, B=area.Area)

# ---- group: Sample Points
mesh_join = MeshJoin(Meshes=extrude)
bounding_box = BoundingBox(Content=mesh_join, Plane=PlaneXY(0, 0, 0))  # -> Box, Box_2
deconstruct_brep = DeconstructBrep(Brep=bounding_box.Box)  # -> Faces, Edges, Vertices
bounds_2 = ListItem(List=deconstruct_brep.Faces, Index=Slider(4, range=0..5), Wrap=True)
precision = Slider(329, range=100..2000)
dimensions = Dimensions(Surface=bounds_2)  # -> UDimension, VDimension
division_2 = Division(A=dimensions.UDimension, B=precision)
division_3 = Division(A=dimensions.VDimension, B=precision)
divide_surface = DivideSurface(Surface=bounds_2, UCount=division_2, VCount=division_3)  # -> Points, Normals, Parameters

# ----
panel_17 = Panel(division)  # disabled
bounds_3 = Bounds(Numbers=division)
panel_18 = Panel(bounds_3)  # disabled
deconstruct_domain = DeconstructDomain(Domain=bounds_3)  # -> Start, End
gradient = Gradient(
    LowerLimit=deconstruct_domain.Start,
    UpperLimit=deconstruct_domain.End,
    Parameter=division,
    stops=[0: RGB(0, 128, 0), 0.5: RGB(255, 255, 0), 1: RGB(255, 0, 0)])
custom_preview_3 = CustomPreview(Geometry=extrude, Material=gradient)
multiplication = Multiplication(A=precision, B=precision)
# 2x number of new metro stations
gene_pool = GenePool(Decimals=2, Maximum=100, Minimum=0, Value=[33.61, 56.11, 50.81, 48.43, 46.89, 36.81, 38.51, 52.59, 36.54, 52.87])

# ---- group: Map Domain
sort_points = SortPoints(Points=deconstruct_brep.Vertices)  # -> Points, Indices
list_item_3 = ListItem(List=sort_points.Points, Index=0, Wrap=True)
list_item_4 = ListItem(List=sort_points.Points, Index=-1, Wrap=True)
deconstruct = Deconstruct(Point=list_item_3)  # -> XComponent, YComponent, ZComponent
deconstruct_2 = Deconstruct(Point=list_item_4)  # -> XComponent, YComponent, ZComponent
construct_domain_2 = ConstructDomain(DomainStart=deconstruct.XComponent, DomainEnd=deconstruct_2.XComponent)
construct_domain_3 = ConstructDomain(DomainStart=deconstruct.YComponent, DomainEnd=deconstruct_2.YComponent)

# ----
galapagos = Galapagos(fitness=addition_2, gene=gene_pool)
list_length = ListLength(List=gene_pool)
series = Series(Start=0, Step=1, Count=list_length)

# ---- group: Population Density Samples
point_in_breps = PointInBreps(Brep=extrude, Point=divide_surface.Points, Strict=False)  # -> Inside, Index
panel_19 = Panel(point_in_breps.Inside)  # disabled
panel_20 = Panel(point_in_breps.Index)  # disabled
region_sample = ListItem(List=extrude, Index=point_in_breps.Index, Wrap=False)
population_sample = ListItem(List=population, Index=point_in_breps.Index, Wrap=False)
area_2 = Area(Geometry=region_sample)  # -> Area, Centroid
panel_21 = Panel(population_sample)
panel_22 = Panel(region_sample)  # disabled
division_4 = Division(A=population_sample, B=area_2.Area)
population_density_sample = Number(division_4)
panel_23 = Panel(population_density_sample)  # disabled

# ----
modulus = Modulus(A=series, B=2)
dispatch = Dispatch(List=gene_pool, DispatchPattern=modulus)  # -> ListA, ListB
remap_numbers_2 = RemapNumbers(Value=dispatch.ListA, Source=Domain(0, 100), Target=construct_domain_2)  # -> Mapped, Clipped
remap_numbers_3 = RemapNumbers(Value=dispatch.ListB, Source=Domain(0, 100), Target=construct_domain_3)  # -> Mapped, Clipped
existing_metro_stations_2 = Point(existing_metro_stations)
construct_point_3 = ConstructPoint(XCoordinate=remap_numbers_2.Clipped, YCoordinate=remap_numbers_3.Clipped, ZCoordinate=0)
unit_z_5 = UnitZ(Factor=1000)
move_4 = Move(Geometry=construct_point_3, Motion=unit_z_5)  # -> Geometry, Transform
merge_lists = CSharpScript(listA=existing_metro_stations_2, listB=construct_point_3)  # -> out, mergedList; inputs listA: list of Point3d, listB: list of Point3d
# ---------- merge_lists: C# ----------
    var list = new List<Point3d>();
    list.AddRange(listA);
    list.AddRange(listB);
    mergedList = list;
# ---------- end merge_lists ----------
colour_3 = Colour(RGB(0, 0, 255))
panel_24 = Panel(merge_lists.mergedList)
custom_preview_4 = CustomPreview(NewStations=move_4.Geometry, Material=colour_3)
point_in_breps_2 = PointInBreps(Brep=extrude, Point=construct_point_3, Strict=False)  # -> Inside, Index
panel_25 = Panel(point_in_breps_2.Inside)
insidemap = CSharpScript(newStations=construct_point_3, allStations=merge_lists.mergedList, inside=point_in_breps_2.Inside)  # -> out, A; inputs newStations: list of Point3d, allStations: list of Point3d, inside: list of Boolean
# ---------- insidemap: C# usings ----------
using System.Linq;
# ---------- insidemap: C# ----------
    double res = 0d;
    for(int i = 0; i < newStations.Count(); i++){
      var p = newStations[i];
      if(inside[i]){
        res += Math.Min(1000, Math.Sqrt(allStations.Min(x => x == p ? 999999999 : x.DistanceToSquared(p))));
      } else {
        res -= 1e9;
      }
    }
    A = res / newStations.Count();
# ---------- end insidemap ----------

weight_population = Slider(1, range=1..1000)
weightinsidemap = Slider(1000, range=1..1000)
weightgenerators = Slider(1, range=1..1000)
sigma = Z(1000)

generators_2 = CSharpScript(stations=merge_lists.mergedList, generators=generators, generatorValues=explode_tree.Branch3, sigma=sigma)  # -> out, n_ij; inputs stations: list of Point3d, generators: list of Point3d, generatorValues: list of Int32, sigma: Double
# ---------- generators_2: C# ----------
    double sigmaSq = sigma * sigma;
    var res = new List<double>();
    foreach(var station in stations){
      double val = 0;
      for(int i = 0; i < generators.Count; i++){
        Point3d point = generators[i];
        int numPeople = generatorValues[i];
        double distSq = point.DistanceToSquared(station);
        //Print(string.Format("Density {0} dist {1}", density, distSq));
        val += numPeople * Math.Exp(-distSq / sigmaSq);
      }
      res.Add(val);
    }
    n_ij = res;
# ---------- end generators_2 ----------
mass_addition = MassAddition(Input=generators_2.n_ij)  # -> Result, PartialResults
panel_26 = Panel(mass_addition.Result)
multiplication_2 = Multiplication(A=mass_addition.Result, B=weightgenerators)
integrate_population = CSharpScript(
    samplePoints=flatten(divide_surface.Points),
    sampleValues=flatten(population_density_sample),
    stationsPos=merge_lists.mergedList,
    sigma=sigma,
    dA=multiplication)  # -> out, n_i; inputs samplePoints: list of Point3d, sampleValues: list of Double, stationsPos: list of Point3d, sigma: Double, dA: Double
# ---------- integrate_population: C# ----------
    double sigmaSq = sigma * sigma;
    var res = new List<double>();
    foreach(var station in stationsPos){

      double val = 0;
      for(int i = 0; i < samplePoints.Count; i++){
        Point3d point = samplePoints[i];
        double density = sampleValues[i];
        double distSq = point.DistanceToSquared(station);
        //Print(string.Format("Density {0} dist {1}", density, distSq));
        val += density * Math.Exp(-distSq / sigmaSq);
      }
      res.Add(dA * val);
    }
    n_i = res;
# ---------- end integrate_population ----------
area_of_influence = CSharpScript(n_i=integrate_population.n_i, n_ij=generators_2.n_ij)  # -> out, s_i; inputs n_i: list of Double, n_ij: list of Double
# ---------- area_of_influence: C# ----------
    var res = new List<double>();
    for(int i = 0; i < n_i.Count; i++){
      res.Add(n_i[i] + n_ij[i]);
    }
    s_i = res;
# ---------- end area_of_influence ----------
panel_27 = Panel(area_of_influence.s_i)
panel_28 = Panel(integrate_population.out)
calc_connections = CSharpScript(
    existingStations=existing_metro_stations_2,
    newStations=construct_point_3,
    connections=read_csv_4.Values,
    s_i=area_of_influence.s_i)  # -> out, lines, objective; inputs existingStations: list of Point3d, newStations: list of Point3d, connections: tree of Int32, s_i: list of Double; disabled
# ---------- calc_connections: C# usings ----------
using System.Threading;
using System.Linq;
# ---------- calc_connections: C# ----------
    int numConnections = connections.Branches[0].Count;


    int numStations = newStations.Count + existingStations.Count;
    double[, ] baseGraph = new double[numStations, numStations];

    for(int i = 0; i < numConnections; i++){
      int first = connections.Branches[0][i];
      int second = connections.Branches[1][i];

      double c_ij = existingStations[first].DistanceTo(existingStations[second]);
      baseGraph[first, second] = c_ij;
      baseGraph[second, first] = c_ij;
    }

    var newStationIds = Enumerable.Range(0, newStations.Count);
    var connectionIds = Enumerable.Range(0, numConnections);
    var pairs = newStationIds
      .SelectMany(g => connectionIds
      .Select(c => new {Station = g, Connection = c})
      );

    var counter = new Counter(newStations.Count, numConnections);

    // store min permutation
    int[] maxCount = new int[newStations.Count];
    double maxObj = double.NegativeInfinity;

    int numIter = 0;
    do {
      if(!counter.IsValid()){continue;}                                   //todo
      //Print("{0}", numIter);
      //if(++numIter > 100) break;
      // brute force insert station to connection or end of line
      double time = 0;
      double cost = 0;

//      Thread.Yield();

      double[,] graph = new double[numStations, numStations];

      for (int i = 0; i < numStations; i++) {
        for (int j = 0; j < numStations; j++) {
          graph[i, j] = baseGraph[i, j];
        }
      }

      for(int i = 0; i < newStations.Count; i++){
        int conn = counter.indices[i]; // connection index
        int newStation = existingStations.Count + i; // new station

        int first = connections.Branches[0][conn];
        int second = connections.Branches[1][conn];

        double c_ij = existingStations[first].DistanceTo(newStations[i]);
        graph[first, newStation] = c_ij;
        graph[newStation, first] = c_ij;
        c_ij = existingStations[second].DistanceTo(newStations[i]);
        graph[second, newStation] = c_ij;
        graph[newStation, second] = c_ij;
      }

      GFG t = new GFG();
      for (int i = 0; i < numStations; i++) {
        double[] d_ij = t.dijkstra(graph, i);

        for (int j = 0; j < numStations; j++) {
          if (i == j) {continue;}

          double t_ij = d_ij[j] * (s_i[i] + s_i[j]);
          //Print("t_ij {0}", t_ij);
          time += t_ij;
          cost += graph[i, j];
        }
      }
      double obj = 1d / (time * cost);
      if(obj > maxObj){
        maxObj = obj;
        maxCount = counter.indices;
      }

      //Print("Time {0} Cost {1} Obj {2}", time, cost, obj);
    } while(counter.Step());
    
    Print("{0}", maxObj);

    lines = maxCount;
    objective = maxObj;
# ---------- calc_connections: C# additional code ----------
  class Counter{
    int N, M;
    public int[] indices;
    public Counter(int N, int M){
      this.N = N; // stations
      this.M = M; // connections
      indices = new int[N];
    }

    public bool Step(){
      int carry = 1; // add 1

      for(int i = 0; i < N; i++){
        indices[i] = (indices[i] + carry) % M;
        carry = (indices[i] + carry) / M;
      }

      return indices[N - 1] < M;
    }

    public bool IsValid(){
      var digits = new HashSet<int>();

      for(int i = 0; i < N; i++){
        if(digits.Contains(indices[i])){
          return false;
        }
        digits.Add(indices[i]);
      }
      return true;
    }
  }

  class GFG {
    // A utility function to find the
    // vertex with minimum distance
    // value, from the set of vertices
    // not yet included in shortest
    // path tree
    static int V;
    int minDistance(double[] dist, bool[] sptSet) {
      // Initialize min value
      double min = double.MaxValue;
      int min_index = -1;

      for (int v = 0; v < V; v++)
        if (sptSet[v] == false && dist[v] <= min) {
          min = dist[v];
          min_index = v;
        }

      return min_index;
    }

    // A utility function to print
    // the constructed distance array
    void printSolution(double[] dist)
    {
      Console.Write("Vertex \t\t Distance "
        + "from Source\n");
      for (int i = 0; i < V; i++)
        Console.Write(i + " \t\t " + dist[i] + "\n");
    }

    // Function that implements Dijkstra's
    // single source shortest path algorithm
    // for a graph represented using adjacency
    // matrix representation
    public double[] dijkstra(double[, ] graph, int src)
    {
      V = graph.GetLength(0);
      double[] dist = new double[V]; // The output array. dist[i]
      // will hold the shortest
      // distance from src to i

      // sptSet[i] will true if vertex
      // i is included in shortest path
      // tree or shortest distance from
      // src to i is finalized
      bool[] sptSet = new bool[V];

      // Initialize all distances as
      // INFINITE and stpSet[] as false
      for (int i = 0; i < V; i++) {
        dist[i] = double.MaxValue;
        sptSet[i] = false;
      }

      // Distance of source vertex
      // from itself is always 0
      dist[src] = 0;

      // Find shortest path for all vertices
      for (int count = 0; count < V - 1; count++) {
        // Pick the minimum distance vertex
        // from the set of vertices not yet
        // processed. u is always equal to
        // src in first iteration.
        int u = minDistance(dist, sptSet);

        // Mark the picked vertex as processed
        sptSet[u] = true;

        // Update dist value of the adjacent
        // vertices of the picked vertex.
        for (int v = 0; v < V; v++)

          // Update dist[v] only if is not in
          // sptSet, there is an edge from u
          // to v, and total weight of path
          // from src to v through u is smaller
          // than current value of dist[v]
          if (!sptSet[v] && graph[u, v] != 0 && dist[u] != double.MaxValue && dist[u] + graph[u, v] < dist[v])
            dist[v] = dist[u] + graph[u, v];
      }

      // print the constructed distance array
      //printSolution(dist);
      return dist;
    }
  }
# ---------- end calc_connections ----------
mass_addition_2 = MassAddition(Input=integrate_population.n_i)  # -> Result, PartialResults
network_value = CSharpScript(
    existingStations=existing_metro_stations_2,
    newStations=construct_point_3,
    connections=read_csv_4.Values,
    s_i=area_of_influence.s_i)  # -> out, lines, objective; inputs existingStations: list of Point3d, newStations: list of Point3d, connections: tree of Int32, s_i: list of Double
# ---------- network_value: C# ----------
    int numConnections = connections.Branches[0].Count;


    int numStations = existingStations.Count;
    double[, ] baseGraph = new double[numStations, numStations];

    for(int i = 0; i < numConnections; i++){
      int first = connections.Branches[0][i];
      int second = connections.Branches[1][i];

      double c_ij = existingStations[first].DistanceTo(existingStations[second]);
      baseGraph[first, second] = c_ij;
      baseGraph[second, first] = c_ij;
    }

    double maxObj = double.NegativeInfinity;

    double time = 0;
    double cost = 0;

    GFG t = new GFG();
    for (int i = 0; i < numStations; i++) {
      double[] d_ij = t.dijkstra(baseGraph, i);

      for (int j = 0; j < numStations; j++) {
        if (i == j) {continue;}

        double t_ij = d_ij[j] * (s_i[i] + s_i[j]);
        //Print("t_ij {0}", t_ij);
        time += t_ij;
        cost += baseGraph[i, j];
      }
    }
    double obj = 1d / (time * cost);
    if (obj > maxObj) {
      maxObj = obj;
    }

    Print("Time {0} Cost {1} Obj {2}", time, cost, obj);

    Print("{0}", maxObj);

    objective = maxObj;
# ---------- network_value: C# additional code ----------
  class Counter{
    int N, M;
    public int[] indices;
    public Counter(int N, int M){
      this.N = N; // stations
      this.M = M; // connections
      indices = new int[N];
    }

    public bool Step(){
      int carry = 1; // add 1

      for(int i = 0; i < N; i++){
        indices[i] = (indices[i] + carry) % M;
        carry = (indices[i] + carry) / M;
      }

      return indices[N - 1] < M;
    }

    public bool IsValid(){
      var digits = new HashSet<int>();

      for(int i = 0; i < N; i++){
        if(digits.Contains(indices[i])){
          return false;
        }
        digits.Add(indices[i]);
      }
      return true;
    }
  }

  class GFG {
    // A utility function to find the
    // vertex with minimum distance
    // value, from the set of vertices
    // not yet included in shortest
    // path tree
    static int V;
    int minDistance(double[] dist, bool[] sptSet) {
      // Initialize min value
      double min = double.MaxValue;
      int min_index = -1;

      for (int v = 0; v < V; v++)
        if (sptSet[v] == false && dist[v] <= min) {
          min = dist[v];
          min_index = v;
        }

      return min_index;
    }

    // A utility function to print
    // the constructed distance array
    void printSolution(double[] dist)
    {
      Console.Write("Vertex \t\t Distance "
        + "from Source\n");
      for (int i = 0; i < V; i++)
        Console.Write(i + " \t\t " + dist[i] + "\n");
    }

    // Function that implements Dijkstra's
    // single source shortest path algorithm
    // for a graph represented using adjacency
    // matrix representation
    public double[] dijkstra(double[, ] graph, int src)
    {
      V = graph.GetLength(0);
      double[] dist = new double[V]; // The output array. dist[i]
      // will hold the shortest
      // distance from src to i

      // sptSet[i] will true if vertex
      // i is included in shortest path
      // tree or shortest distance from
      // src to i is finalized
      bool[] sptSet = new bool[V];

      // Initialize all distances as
      // INFINITE and stpSet[] as false
      for (int i = 0; i < V; i++) {
        dist[i] = double.MaxValue;
        sptSet[i] = false;
      }

      // Distance of source vertex
      // from itself is always 0
      dist[src] = 0;

      // Find shortest path for all vertices
      for (int count = 0; count < V - 1; count++) {
        // Pick the minimum distance vertex
        // from the set of vertices not yet
        // processed. u is always equal to
        // src in first iteration.
        int u = minDistance(dist, sptSet);

        // Mark the picked vertex as processed
        sptSet[u] = true;

        // Update dist value of the adjacent
        // vertices of the picked vertex.
        for (int v = 0; v < V; v++)

          // Update dist[v] only if is not in
          // sptSet, there is an edge from u
          // to v, and total weight of path
          // from src to v through u is smaller
          // than current value of dist[v]
          if (!sptSet[v] && graph[u, v] != 0 && dist[u] != double.MaxValue && dist[u] + graph[u, v] < dist[v])
            dist[v] = dist[u] + graph[u, v];
      }

      // print the constructed distance array
      //printSolution(dist);
      return dist;
    }
  }
# ---------- end network_value ----------
multiplication_3 = Multiplication(A=area_of_influence.s_i, B=0.01)
multiplication_4 = Multiplication(A=insidemap.A, B=weightinsidemap)
panel_29 = Panel(network_value.out)
multiplication_5 = Multiplication(A=mass_addition_2.Result, B=weight_population)
panel_30 = Panel(calc_connections.out)
panel_31 = Panel(calc_connections.lines)
panel_32 = Panel(calc_connections.objective)
panel_33 = Panel(network_value.objective)

# ---- group: Number of People
bounds_4 = Bounds(Numbers=multiplication_3)
deconstruct_domain_2 = DeconstructDomain(Domain=bounds_4)  # -> Start, End
sphere = Sphere(Base=merge_lists.mergedList, Radius=multiplication_3)
unit_z_6 = UnitZ(Factor=1000)
gradient_2 = Gradient(
    LowerLimit=deconstruct_domain_2.Start,
    UpperLimit=deconstruct_domain_2.End,
    Parameter=multiplication_3,
    stops=[0: RGB(188, 179, 58), 0: RGB(0, 128, 0), 0.5: RGB(255, 255, 0), 1: RGB(255, 0, 0)])
move_5 = Move(Geometry=sphere, Motion=unit_z_6)  # -> Geometry, Transform
create_material = CreateMaterial(Diffuse=gradient_2, Specular=RGB(255, 255, 255), Emission=RGB(0, 0, 0), Transparency=0.5, Shine=0)
custom_preview_5 = CustomPreview(Geometry=move_5.Geometry, Material=create_material)

# ----
addition = Addition(A=multiplication_5, B=multiplication_4)
panel_34 = Panel(multiplication_4)
panel_35 = Panel(mass_addition_2.Result)
panel_36 = Panel(addition)
addition_2 = Addition(A=addition, B=multiplication_2)
panel_37 = Panel(addition_2)
